# Grasshopper definition DRVaa.gh (Grasshopper 1.0.8)
# plug-ins: CORE.Toolbox.Grasshopper, Pufferfish, Urbano, Human, ANTflow.Components, MetaHopper

panel = Panel("consolas")
panel_2 = Panel("poppins")

# ---- group: INPUT
path = FilePath("C:\Users\l03063058\Desktop\Github\DRVaa\Grasshopper\cityModels\SJO_match_large.osm")
panel_3 = Panel(path)

# ----
texttoscreen = RenderTextToScreen(
    Text="DRVA/A",
    Location="100,100",
    Size=Slider(32, range=0..100),
    Color=ColourSwatch(SwatchColor=RGB(255, 255, 255)),
    m_scWithvp=False)
# URBANO 1
panel_4 = Panel(path)
number_slider = Slider(18, range=0..100)

# ---- group: CSV file with perception data for each street segment (through LLM or participatory design)
path_2 = FilePath("C:\Users\l03063058\Desktop\Github\DRVaa\street_segments_scored_360_2.csv")

# ----
swatch = ColourSwatch(SwatchColor=RGB(255, 255, 255))

importosm = ImportOSMFeatures(OSMPathOrURL=path, OSMFeatureType="building", Format="xml", ImportAltitude=False)  # -> Points, Metadata, UTMZone, TranslationVector
importosm_2 = ImportOSMFeatures(OSMPathOrURL=path, OSMFeatureType="street", Format="xml", ImportAltitude=False)  # -> Points, Metadata, UTMZone, TranslationVector
importosm_3 = ImportOSMFeatures(OSMPathOrURL=path, OSMFeatureType="amenity", Format="xml", ImportAltitude=False)  # -> Points, Metadata, UTMZone, TranslationVector
pline = PolyLine(Vertices=importosm_2.Points, Closed=False)
pline_2 = PolyLine(Vertices=importosm.Points, Closed=invert(False))
amen = CreateAmenity(PointLocationOfAmenity=importosm_3.Points, Metadata=importosm_3.Metadata)
streetnet = CreateStreetNetwork(
    StreetCurves=flatten(pline),
    Metadata=flatten(importosm_2.Metadata),
    SplitStreetCurves=True,
    UTMZone=importosm_2.UTMZone,
    TranslationVector=importosm_2.TranslationVector)  # -> StreetNetwork, StreetSegmentCurves, UTMZone, TranslationVector
bldg = CreateBuilding(BuildingCurve=pline_2, Metadata=importosm.Metadata, AmenitiesInBuilding=amen)
model = BuildUrbanoModel(Buildings=flatten(bldg), StreetNetwork=streetnet.StreetNetwork, BuildToggle=False)  # -> UrbanoModel, BuildingCurves, Activities
inbldg = InspectBuilding(Building=bldg, UrbanoModel=model.UrbanoModel, DefaultHeight=10)  # -> Geometry, Metadata, Amenity, flatten(BuildingMesh)

texttoscreen_2 = RenderTextToScreen(Text="INPUTS", Location="500,820,0", Size=number_slider, Color=swatch, m_scWithvp=False)
crv = Curve([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])
Y = UnitY(Factor=Slider(1995, range=0..10000))
move = Move(Geometry=crv, Motion=Y)  # -> Geometry, Transform
number_slider_2 = Slider(0.1, range=0..1)
panel_7 = Panel("320,1000")
texttoscreen_3 = RenderTextToScreen(Text="OUTPUTS", Location="900,820,200", Size=number_slider, Color=swatch, m_scWithvp=False)
pt = Point(<point referenced from the Rhino model>)
pt_2 = Point(<point referenced from the Rhino model>)
swatch_2 = ColourSwatch(SwatchColor=RGB(255, 255, 255))
crvtoscreen = RenderCurveToScreen(
    Curve=crv,
    Location="320,800",
    ScaleFactor=Slider(0.5, range=0..1),
    Color=swatch_2,
    Thickness=1,
    Depth=".99",
    Fixed=True,
    m_scWithvp=False)
crvtoscreen_2 = RenderCurveToScreen(
    Curve=streetnet.StreetSegmentCurves,
    Location="50,900",
    ScaleFactor=number_slider_2,
    Color=ColourSwatch(SwatchColor=RGB(255, 255, 255)),
    Thickness=1,
    Depth=".99",
    Fixed=True,
    m_scWithvp=False)
previewlw = CustomPreviewLineweights(Geometry=move.Geometry, Shader=swatch_2, Absolute=False)
swatch_3 = ColourSwatch(SwatchColor=RGBA(2, 124, 153, 177))
swatch_4 = ColourSwatch(SwatchColor=RGB(38, 137, 117))
swatch_5 = ColourSwatch(SwatchColor=RGB(98, 103, 104))

pt_3 = Point(pt_2)
pt_4 = Point(pt)

argb = SplitARGB(Colour=swatch_5, IntegerChannels=True)  # -> Alpha, Red, Green, Blue

# ---- group: RESULTADOS / Huellas de edificios
crv_2 = Curve(inbldg.Geometry)

# ---- group: RESULTADOS / Volumetrías
geo = Geometry(inbldg.BuildingMesh)

# ---- group: RESULTADOS / Red de calles
crv_3 = Curve(streetnet.StreetSegmentCurves)

# ---- group: Generate streets
swatch_6 = ColourSwatch(SwatchColor=RGB(0, 74, 117))
previewlw_2 = CustomPreviewLineweights(Geometry=crv_3, Shader=swatch_5, Absolute=False)

# ---- group: Origin vs Destination
pt_5 = Point(pt_3)
pt_6 = Point(pt_4)
dot = AnnotationDot(Location=pt_5, PrimaryText="Origin", TextHeight=Slider(12, range=0..100))  # -> AnnotationDot, Location, PrimaryText, SecondaryText, TextHeight, Font
dots = DotDisplay(Point=[pt_5, pt_6], Colour=ColourSwatch(SwatchColor=RGB(2, 205, 153)), Size=Slider(14, range=0..100))
dot_2 = AnnotationDot(AnnotationDot=dot.AnnotationDot, Location=pt_6, PrimaryText="Destination")  # -> AnnotationDot, Location, PrimaryText, SecondaryText, TextHeight, Font

# ----
texttoscreen_4 = RenderTextToScreen(
    Text="Chromatic spectrum of 360 image (ordered by HSV)",
    Location="1300,850",
    Size=12,
    Color=ColourSwatch(SwatchColor=RGB(255, 255, 9)),
    m_scWithvp=False)
rgb = ColourRGB(Alpha="153", Red=argb.Red, Green=argb.Green, Blue=argb.Blue)

# ---- group: Generate buildings
swatch_7 = ColourSwatch(SwatchColor=RGBA(2, 124, 153, 177))
swatch_8 = ColourSwatch(SwatchColor=RGBA(100, 103, 102, 159))
preview = CustomPreview(Geometry=geo, Material=rgb)

# ----
splitstr = SplitStreetCurves(SplitStreetCurves=flatten(crv_3), IntersectionTolerance=1e-12)  # -> ProcessedStreetCurves, Metadata

# ---- group: Street names
lookup = LookupMetadata(MetadataGeometry=flatten(importosm_2.Metadata), SearchKey="name")
hframe = HorizontalFrame(Curve=reparameterize(splitstr.ProcessedStreetCurves), Parameter=Slider(0.5, range=0..1))
tag = TextTag3D(
    Location=hframe,
    Text=lookup,
    Size=Slider(4, range=0..10),
    Colour=ColourSwatch(SwatchColor=RGB(0, 0, 0)),
    Justification=7)

# ----
panel_8 = Panel(lookup)
texttoscreen_5 = RenderTextToScreen(
    Text="360 image at selected node",
    Location="1300,670",
    Size=12,
    Color=ColourSwatch(SwatchColor=RGB(255, 255, 9)),
    m_scWithvp=False)
number_slider_3 = Slider(10, range=1..50)
lng = ListLength(List=splitstr.ProcessedStreetCurves)
number_of_segments = Panel(lng)
swatch_9 = ColourSwatch(SwatchColor=RGB(255, 0, 128))

concat = Concatenate(FragmentA="Number of routes to explore: ", FragmentB=number_slider_3)
texttoscreen_6 = RenderTextToScreen(Text=concat, Location="500,850", Size=12, Color=ColourSwatch(SwatchColor=RGB(255, 255, 255)), m_scWithvp=False)

# ---- group: attach to edges / insert street segments
crv_4 = Curve(streetnet.StreetSegmentCurves)

# ---- group: attach to edges / distance threshold
number_slider_4 = Slider(5, range=0..100)

# ----
panel_10 = Panel("""Acoustic Comfort
Thermal Comfort
Anti-somatic Stress
Social Vitality
Territorial Safety
Olfactive Resonance""")
graft = GraftTree(Tree=panel_10, IncludeEmptyLists=True, IncludeNullItems=True)  # -> simplify(Tree)
panel_11 = Panel(graft)
panel_12 = Panel("""You are an expert affective routing engine and urban psychogeography assistant. Your task is to recommend the optimal pedestrian route based on pre-calculated environmental affect tensors. Traditional navigation optimizes strictly for physical efficiency, but you optimize for subjective spatial experience, atmospheric alignment, and cognitive comfort.

You will evaluate routes composed of street segment indexes. Each segment contains quantitative scores for six affective dimensions:

Acoustic Comfort: The subjective sense of auditory tranquility and noise mitigation.

Thermal Comfort: The inferred microclimatic quality, thermodynamic ease, and protective shade.

Anti-somatic Stress: The reduction of cognitive load, ambient anxiety, and psychophysiological stress.

Social Vitality: The degree of human activity, commercial energy, and civic vibrancy present along the edge.

Territorial Safety: The subjective, precognitive perception of physical protection, legibility, and psychological security.

Olfactive Resonance: The environment's capacity to evoke affective memory, cultural identity, and pleasant scentscapes.

Based on the user's natural language request (e.g., "a path that feels calm and protective"), analyze the provided JSON of route options. Aggregate the segment scores for each path, weight them according to the user's implied priorities, and select the route that best matches the desired sensory atmosphere. Provide the chosen route ID and a concise rationale connecting the quantitative affect scores to the user's qualitative request.""")
panel_13 = Panel("""The user has requested the following sensory experience for their journey. 

Below is the JSON data containing the available route options. Each route includes a sequence of street segment indexes """)
path_3 = FilePath("C:\Users\l03063058\Desktop\Github\gemini_api.txt")
toggle = BooleanToggle(True)
file = ReadFile(File=path_3, PerLineParse=True)
panel_14 = Panel("Extract ony the route number out of the given result. Nothing else.")
directory = Panel("C:\Users\l03063058\Desktop\Github\DRVaa\streetview_panoramas_360\")
onoff = EnableDisableObject(Enabled=Toggle(False), AllObjects_Object=cylinder)

# ----
# LLM Walkability Perception
panel_15 = Panel(path_2)
path_4 = FilePath("C:\Users\l03063058\Desktop\Github\DRVaa\SHPs\streets_scored_SJO_large\street_scored.shp")
panel_16 = Panel(path_4)

# ---- group: CSV to SHP v003
py3 = Python3Script(csv_file=path_2, shp_file_path=path_4)  # -> GeoDataFrame, shp_file
#   port csv_file: CSV file with perception data (machine or human) for each street segment. File should include columns named latitude and longitude so it can georeference each street segment and convert to SHP file.
#   port shp_file_path: Select file path where SHP file will be saved.
# ---------- py3: Python ----------
#! python3
#r: pandas, geopandas

import pandas as pd
import geopandas as gpd
from shapely.geometry import Point

# Read CSV file
df = pd.read_csv(csv_file)


# Make sure CSV file has columns for latitud and longitud
# if 'latitude' not in df.columns or 'longitude' not in df.columns:
    # raise ValueError("CSV file must have 'latitude' and 'longitude' columns")
    

# Create point geometry based on coordinates
geometry = [Point(xy) for xy in zip(df['longitude'], df['latitude'])]
gdf = gpd.GeoDataFrame(df, geometry=geometry)

# Establish reference system (CRS), WGS84 for example
gdf.set_crs(epsg=4326, inplace=True)

# Display dataframe
GeoDataFrame = gdf

# Save as Shapefile
gdf.to_file(shp_file_path)

shp_file = shp_file_path

# print(GeoDataFrame.crs)
# ---------- end py3 ----------

# ----
panel_17 = Panel(py3.GeoDataFrame)

# ---- group: SHP to GeoDataframe
py3_2 = Python3Script(SHP=py3.shp_file)  # -> GeoDataFrame
# ---------- py3_2: Python ----------
#! python3
#r: geopandas


#THIS IS NECESSARY TO LOAD PANDAS otherwise it bugs
import locale
locale.setlocale(locale.LC_ALL, 'en_US')

import geopandas as gpd

GeoDataFrame = gpd.read_file(SHP)
# ---------- end py3_2 ----------

# ---- group: Dataframe Details
py3_3 = Python3Script(dataFrame=py3_2)  # -> info, column_name, head_x10, tail_x10, shape, number_of_null_values
# ---------- py3_3: Python ----------
info = dataFrame.info

head_x10 = dataFrame.head(10)
tail_x10 = dataFrame.tail(10)
shape = dataFrame.shape

#Add up all null values
number_of_null_values = dataFrame.isnull().sum()



# columns = dataFrame.columns
# Get the columns as a list
column_name = dataFrame.columns.tolist()

# Output the list
# print(column_name)
# ---------- end py3_3 ----------

# ----
panel_18 = Panel(py3_3.column_name)

perception_list = ValueList({"acoustic comfort": 6, "thermal comfort": 7, "somatic stress": 8, "social vitality": 9, "territorial safety": 10, "olfactory resonance": 11}, selected="somatic stress")
item = ListItem(List=py3_3.column_name, Index=perception_list, Wrap=True)

filter = StreamFilter(
    Gate=perception_list,
    Stream6="Acoustic comfort",
    Stream7="Thermal comfort",
    Stream8="Somatic stress",
    Stream9="Social vitality",
    Stream10="Territorial safety",
    Stream11="Olfactory resonance")
swatch_10 = ColourSwatch(SwatchColor=RGB(255, 255, 255))
texttoscreen_7 = RenderTextToScreen(Text=filter, Location="500,910", Size=Slider(30, range=0..100), Color=swatch_9, m_scWithvp=False)

# ----
# Perception (9s)
bounding_box = Relay()

panel_20 = Panel(py3_3.head_x10)
importshp = ImportShapefileFeatures(
    ShapefilePath=py3.shp_file,
    Reproject=False,
    UTMZone=streetnet.UTMZone,
    TranslationVector=streetnet.TranslationVector,
    CroppingGeometry=bounding_box)  # -> simplify(flatten(Points)), Metadata, UTMZone, TranslationVector
demeta = DeconstructMetadata(Metadata=importshp.Metadata)  # -> Keys, Values
panel_22 = Panel(demeta.Values)
panel_23 = Panel(demeta.Keys)

panel_24 = Panel(importshp.Points)

# ----
# FILTERING
lookup_2 = LookupMetadata(MetadataGeometry=importshp.Metadata, SearchKey=item)
pt_7 = Point(flatten(importshp.Points))

bnd = Bounds(Numbers=lookup_2)
dedomain = DeconstructDomain(Domain=bnd)  # -> Start, End
panel_25 = Panel(dedomain.Start)
panel_26 = Panel(dedomain.End)

dots_2 = DotDisplay(Point=pt_7, Colour=ColourSwatch(SwatchColor=RGB(238, 95, 131)), Size=Slider(5, range=0..20))
dup_pts = CleanDuplicatePoints(Points=pt_7, Tolerance=0.01)  # -> Points, Indices, Status
dispatch = Dispatch(List=lookup_2, DispatchPattern=dup_pts.Status)  # -> ListA, ListB
panel_27 = Panel(dispatch.ListA)

points = PointList(Points=pt_7, Size=Slider(6, range=0..10))

# ---- group: raw
tag_2 = TextTag(Location=pt_7, Text=lookup_2)

# ---- group: eliminated duplicates
tag_3 = TextTag(Location=flatten(dup_pts.Points), Text=dispatch.ListA, Colour=ColourSwatch(SwatchColor=RGB(0, 0, 0)))

# ---- group: attach to edges / Insert points
pt_8 = Point(dup_pts.Points)

# ----
num = Number(dispatch.ListA)

# ---- group: Node selection
item_2 = ListItem(List=py3_3.column_name, Index=Slider(5, range=0..42), Wrap=True)
lookup_3 = LookupMetadata(MetadataGeometry=importshp.Metadata, SearchKey=item_2)
dispatch_2 = Dispatch(List=lookup_3, DispatchPattern=dup_pts.Status)  # -> ListA, ListB

# ---- group: Olfactory
item_3 = ListItem(List=py3_3.column_name, Index=Slider(11, range=0..42), Wrap=True)
lookup_4 = LookupMetadata(MetadataGeometry=importshp.Metadata, SearchKey=item_3)
dispatch_3 = Dispatch(List=lookup_4, DispatchPattern=dup_pts.Status)  # -> ListA, ListB

# ---- group: Social
item_4 = ListItem(List=py3_3.column_name, Index=Slider(9, range=0..42), Wrap=True)
lookup_5 = LookupMetadata(MetadataGeometry=importshp.Metadata, SearchKey=item_4)
dispatch_4 = Dispatch(List=lookup_5, DispatchPattern=dup_pts.Status)  # -> ListA, ListB

# ---- group: Safety
item_5 = ListItem(List=py3_3.column_name, Index=Slider(10, range=0..42), Wrap=True)
lookup_6 = LookupMetadata(MetadataGeometry=importshp.Metadata, SearchKey=item_5)
dispatch_5 = Dispatch(List=lookup_6, DispatchPattern=dup_pts.Status)  # -> ListA, ListB

# ---- group: Thermal
item_6 = ListItem(List=py3_3.column_name, Index=Slider(7, range=0..42), Wrap=True)
lookup_7 = LookupMetadata(MetadataGeometry=importshp.Metadata, SearchKey=item_6)
dispatch_6 = Dispatch(List=lookup_7, DispatchPattern=dup_pts.Status)  # -> ListA, ListB

# ---- group: Acoustic
item_7 = ListItem(List=py3_3.column_name, Index=Slider(6, range=0..42), Wrap=True)
lookup_8 = LookupMetadata(MetadataGeometry=importshp.Metadata, SearchKey=item_7)
dispatch_7 = Dispatch(List=lookup_8, DispatchPattern=dup_pts.Status)  # -> ListA, ListB

# ---- group: Fastest route
number_slider_5 = Slider(0, range=0..10)
swatch_11 = ColourSwatch(SwatchColor=RGB(0, 255, 0))

# ---- group: New router gets more than one optimal route
n_shortest_routes = Python3Script(Lines=splitstr.ProcessedStreetCurves, StartPt=pt_5, EndPt=pt_6, Penalty="10.0", K=number_slider_3)  # -> out, Routes, RouteIndices; inputs Lines: list of Curve, StartPt: Point3d, EndPt: Point3d, Penalty: Double, K: Int32
#   port Lines: Lines to convert to network.
#   port StartPt: Origin point.
#   port EndPt: Destination point.
#   port Penalty: Edge penalization to control how drastically the routes are forced to diverge. This, at the same time, forces the algorithm to give distinctive, alternative routes. A good starting point is 10.0
#   port K: Number of routes to be generated.
#   port Routes: Generated n routes.
#   port RouteIndices: Indices for line segments within routes.
# ---------- n_shortest_routes: Python ----------
#! python 3
# r: networkx

import rhinoscriptsyntax as rs
import Rhino.Geometry as rg
import networkx as nx

# NEW: Import Grasshopper's native Data Tree modules
import Grasshopper
from Grasshopper.Kernel.Data import GH_Path
import System

def get_distinct_paths_with_indices(curves, start_pt, end_pt, k, penalty_factor):
    if isinstance(curves, rg.Curve):
        curves = [curves]
        
    G = nx.Graph()
    
    def pt_to_key(pt):
        return (round(pt.X, 3), round(pt.Y, 3), round(pt.Z, 3))
        
    edge_geometries = {}
    edge_indices = {} 
    
    print("1. Building graph...")
    for original_idx, crv in enumerate(curves):
        if not crv: continue
        
        segments_to_process = []
        if crv.IsPolyline():
            success, polyline = crv.TryGetPolyline()
            if success:
                for seg in polyline.GetSegments():
                    segments_to_process.append(rg.LineCurve(seg))
        else:
            segments_to_process.append(crv)
            
        for seg_crv in segments_to_process:
            p1 = seg_crv.PointAtStart
            p2 = seg_crv.PointAtEnd
            
            k1 = pt_to_key(p1)
            k2 = pt_to_key(p2)
            
            length = seg_crv.GetLength()
            
            G.add_edge(k1, k2, weight=length)
            
            edge_geometries[(k1, k2)] = seg_crv
            edge_geometries[(k2, k1)] = seg_crv 
            edge_indices[(k1, k2)] = original_idx
            edge_indices[(k2, k1)] = original_idx
            
    if len(G.nodes) == 0:
        print("Error: No valid lines were provided.")
        return [], []

    def find_closest_node(graph, target_pt):
        closest_node = None
        min_dist = float('inf')
        for node in graph.nodes:
            node_pt = rg.Point3d(node[0], node[1], node[2])
            dist = target_pt.DistanceTo(node_pt)
            if dist < min_dist:
                min_dist = dist
                closest_node = node
        return closest_node

    start_key = find_closest_node(G, start_pt)
    end_key = find_closest_node(G, end_pt)
    
    k_paths_curves = []
    k_paths_indices = [] 
    
    print("2. Calculating distinctly penalized paths...")
    for i in range(k):
        try:
            path = nx.shortest_path(G, source=start_key, target=end_key, weight='weight')
            
            path_curves = []
            raw_path_indices = []
            
            for j in range(len(path) - 1):
                node_a = path[j]
                node_b = path[j+1]
                
                path_curves.append(edge_geometries[(node_a, node_b)])
                raw_path_indices.append(edge_indices[(node_a, node_b)])
                
                current_weight = G[node_a][node_b]['weight']
                G[node_a][node_b]['weight'] = current_weight * penalty_factor
                
            joined_curves = rg.Curve.JoinCurves(path_curves)
            if joined_curves:
                k_paths_curves.append(joined_curves[0])
                
                clean_indices = []
                for idx in raw_path_indices:
                    if not clean_indices or clean_indices[-1] != idx:
                        clean_indices.append(idx)
                
                k_paths_indices.append(clean_indices)
                
        except nx.NetworkXNoPath:
            print(f"Stopped early at {i} routes: No more valid alternative paths exist.")
            break
        except Exception as e:
            print("An error occurred: " + str(e))
            break
            
    print(f"Success: Found {len(k_paths_curves)} distinct routes.")
    
    # NEW: Convert the nested Python list into a strict Grasshopper Data Tree
    gh_tree = Grasshopper.DataTree[System.Object]()
    for branch_index, indices_list in enumerate(k_paths_indices):
        path = GH_Path(branch_index)
        for index_val in indices_list:
            gh_tree.Add(index_val, path)
            
    return k_paths_curves, gh_tree

if Lines and StartPt and EndPt and K and Penalty:
    Routes, RouteIndices = get_distinct_paths_with_indices(Lines, StartPt, EndPt, K, Penalty)
# ---------- end n_shortest_routes ----------

# ---- group: Fastest route (continued)
branch = BranchByIndex(Tree=n_shortest_routes.RouteIndices, Branch=number_slider_5)
item_8 = ListItem(List=n_shortest_routes.Routes, Index=0, Wrap=True)
item_9 = ListItem(List=crv_3, Index=branch, Wrap=True)
len = Length(Curve=item_8)
path_distance = Panel(len)
previewlw_3 = CustomPreviewLineweights(Geometry=item_9, Shader=swatch_11, Thickness=Slider(3, range=0..10), Absolute=False)

# ----
lng_2 = ListLength(List=n_shortest_routes.Routes)
index = ItemIndex(List=n_shortest_routes.Routes, Item=n_shortest_routes.Routes)
gradient = Gradient(
    LowerLimit=0,
    UpperLimit=lng_2,
    Parameter=index,
    stops=[0: RGB(243, 57, 0), 0.1: RGB(236, 27, 60), 0.2: RGB(210, 0, 118), 0.3: RGB(103, 0, 120), 0.4: RGB(39, 72, 161), 0.5: RGB(1, 192, 229), 0.6: RGB(18, 178, 90), 0.7: RGB(79, 186, 8), 0.8: RGB(220, 237, 32), 0.9: RGB(247, 159, 20), 1: RGB(243, 57, 0)])
int = Integer(path_distance)
len_2 = Length(Curve=n_shortest_routes.Routes)
concat_2 = Concatenate(FragmentA="Shortest route: ", FragmentB=int, FragmentC="m")

texttoscreen_8 = RenderTextToScreen(Text=concat_2, Location="900,850", Size=12, Color=swatch_11, m_scWithvp=False)

panel_28 = Panel(len_2)
panel_29 = Panel(gradient)
previewlw_4 = CustomPreviewLineweights(Geometry=n_shortest_routes.Routes, Shader=gradient, Thickness="7", Absolute=False)

number_slider_6 = Slider(2, range=0..10)
crvtoscreen_3 = RenderCurveToScreen(
    Curve=item_9,
    Location="50,900",
    ScaleFactor=number_slider_2,
    Color=swatch_11,
    Thickness=number_slider_6,
    Depth="0.99",
    Fixed=True,
    m_scWithvp=False)

tstat = TreeStatistics(Tree=n_shortest_routes.RouteIndices)  # -> Paths, Length, Count
series = Series(Start=0, Step=1, Count=tstat.Count)
concat_3 = Concatenate(FragmentA="Route ", FragmentB=series)
graft_2 = GraftTree(Tree=concat_3, IncludeEmptyLists=True, IncludeNullItems=True)  # -> simplify(Tree)
panel_30 = Panel(graft_2)
data_trees_to_json = DataTreesToJSON(Keys_tree=graft_2, Values_tree=n_shortest_routes.RouteIndices)  # -> Status, JSONPath
json_contents = JSONContents(File_path=data_trees_to_json.JSONPath)
concat_4 = Concatenate(FragmentA=panel_13, FragmentB=json_contents)
panel_31 = Panel(json_contents)
panel_32 = Panel(concat_4)

# ---- group: Column Values 001
py3_4 = Python3Script(dataFrame=py3.GeoDataFrame, column_name="acoustic")  # -> columnValues
# ---------- py3_4: Python ----------
columnValues = dataFrame[column_name].tolist()
# ---------- end py3_4 ----------

# ----
viewer = ParamViewer(py3_4)
panel_33 = Panel(py3_4)

swatch_12 = ColourSwatch(SwatchColor=RGB(255, 255, 255))

# ---- group: attach to edges
midpt = CurveMiddle(Curve=crv_4)
pull = PullPoint(Point=pt_8, Geometry=graft(midpt), ClosestOnly=True)  # -> ClosestPoint, Distance, Index
avr = Average(Input=num)
number_slider_7 = Slider(9, range=0..10)
panel_36 = Panel(avr)
smaller = SmallerThan(FirstNumber=pull.Distance, SecondNumber=number_slider_4)  # -> SmallerThan, OrEqualTo
dispatch_8 = Dispatch(List=pull.ClosestPoint, DispatchPattern=smaller.SmallerThan)  # -> ListA, ListB
dispatch_9 = Dispatch(List=dispatch.ListA, DispatchPattern=smaller.SmallerThan)  # -> ListA, ListB
pt_9 = Point(dispatch_8.ListA)
points_2 = PointList(Points=flatten(pt_9), Size=number_slider_7)
panel_37 = Panel(pt_9)

# ---- group: attach to edges / check index
points_3 = PointList(Points=flatten(midpt), Size=number_slider_7)

# ---- group: attach to edges / Output: reordered data
data = Data(dispatch_9.ListA)

# ---- group: Olfactory / Select cylinder
dispatch_10 = Dispatch(List=dispatch_3.ListA, DispatchPattern=smaller.SmallerThan)  # -> ListA, ListB
item_10 = ListItem(List=dispatch_10.ListA, Index=0, Wrap=True)
nullrep = ReplaceNulls(Items=item_10, Replacements="0")  # -> flatten(Items), Count
item_11 = ListItem(List=nullrep.Items, Index=n_shortest_routes.RouteIndices, Wrap=True)

# ---- group: Social / Select cylinder
dispatch_11 = Dispatch(List=dispatch_4.ListA, DispatchPattern=smaller.SmallerThan)  # -> ListA, ListB
item_12 = ListItem(List=dispatch_11.ListA, Index=0, Wrap=True)
nullrep_2 = ReplaceNulls(Items=item_12, Replacements="0")  # -> flatten(Items), Count
item_13 = ListItem(List=nullrep_2.Items, Index=n_shortest_routes.RouteIndices, Wrap=True)

# ---- group: Safety / Select cylinder
dispatch_12 = Dispatch(List=dispatch_5.ListA, DispatchPattern=smaller.SmallerThan)  # -> ListA, ListB
item_14 = ListItem(List=dispatch_12.ListA, Index=0, Wrap=True)
nullrep_3 = ReplaceNulls(Items=item_14, Replacements="0")  # -> flatten(Items), Count
item_15 = ListItem(List=nullrep_3.Items, Index=n_shortest_routes.RouteIndices, Wrap=True)

# ---- group: Thermal / Select cylinder
dispatch_13 = Dispatch(List=dispatch_6.ListA, DispatchPattern=smaller.SmallerThan)  # -> ListA, ListB
item_16 = ListItem(List=dispatch_13.ListA, Index=0, Wrap=True)
nullrep_4 = ReplaceNulls(Items=item_16, Replacements="0")  # -> flatten(Items), Count
item_17 = ListItem(List=nullrep_4.Items, Index=n_shortest_routes.RouteIndices, Wrap=True)

# ---- group: Acoustic / Select cylinder
dispatch_14 = Dispatch(List=dispatch_7.ListA, DispatchPattern=smaller.SmallerThan)  # -> ListA, ListB
item_18 = ListItem(List=dispatch_14.ListA, Index=0, Wrap=True)
nullrep_5 = ReplaceNulls(Items=item_18, Replacements="0")  # -> flatten(Items), Count
item_19 = ListItem(List=nullrep_5.Items, Index=n_shortest_routes.RouteIndices, Wrap=True)

# ----
panel_38 = Panel(item_11)
panel_39 = Panel(item_13)
panel_40 = Panel(item_15)
panel_41 = Panel(item_17)
panel_42 = Panel(item_19)

# ---- group: attach to edges (continued)
item_20 = ListItem(List=data, Index=0, Wrap=True)
panel_43 = Panel(item_20)
bnd_2 = Bounds(Numbers=flatten(item_20))
nullrep_6 = ReplaceNulls(Items=item_20, Replacements="0")  # -> flatten(Items), Count
dedomain_2 = DeconstructDomain(Domain=bnd_2)  # -> Start, End

# ----
conditional_remap = Python3Script(selection=item, values=nullrep_6.Items, conditional="stress")  # -> remapped_values; inputs selection: String, values: list of Double, conditional: String
# ---------- conditional_remap: Python ----------
"""
Grasshopper Python Script: Conditional Remap for Somatic Stress
Inputs:
    values: List of floats (List Access)
    selection: String from Value List (Item Access)
Outputs:
    remapped_values: Processed values
"""

if values is not None and selection is not None and conditional is not None:
    # Handle single float inputs gracefully
    if isinstance(values, (int, float)):
        values = [values]

    # Check if conditional is met
    is_true = conditional in str(selection).lower()

    if is_true:
        remapped = []
        for v in values:
            if v > 0:
                remapped.append(100 - v)
            else: 
                remapped.append(0.0)
            
        remapped_values = remapped
    else:
        # Do not remap: return original values unchanged
        remapped_values = values
# ---------- end conditional_remap ----------

# ---- group: Check individual segments
item_21 = ListItem(List=conditional_remap, Index="126", Wrap=True)
item_22 = ListItem(List=crv_4, Index="126", Wrap=True)
panel_44 = Panel(item_22)
panel_45 = Panel(item_21)

# ---- group: attach to edges (continued)
gradient_2 = Gradient(
    LowerLimit=Slider(100, range=0..100),
    UpperLimit=Slider(0, range=0..100),
    Parameter=conditional_remap,
    stops=[0: RGB(27, 117, 166), 0.125: RGB(0, 163, 191), 0.25: RGB(0, 201, 188), 0.375: RGB(135, 237, 161), 0.5: RGB(224, 224, 45), 0.625: RGB(250, 208, 82), 0.75: RGB(250, 160, 50), 0.875: RGB(232, 111, 30), 1: RGB(191, 40, 23)])
col = Colour(gradient_2)
panel_46 = Panel(col)
previewlw_5 = CustomPreviewLineweights(Geometry=crv_4, Shader=col, Thickness=Slider(3, range=0..10), Absolute=False)

# ---- group: attach to edges / matched & filtered
tag_4 = TextTag(Location=midpt, Text=flatten(conditional_remap))

# ----
panel_47 = Panel(conditional_remap)

# ---- group: perception scores
item_23 = ListItem(List=conditional_remap, Index=n_shortest_routes.RouteIndices, Wrap=True)
num_2 = Number(item_23)
avr_2 = Average(Input=num_2)  # -> flatten(ArithmeticMean)
listdexs = ListIndices(List=avr_2)
panel_49 = Panel(avr_2)
sort = SortList(Keys=avr_2, ValuesA=listdexs)  # -> reverse(Keys), reverse(ValuesA)
panel_50 = Panel(sort.ValuesA)
panel_51 = Panel(sort.Keys)
item_24 = ListItem(List=sort.ValuesA, Index=0, Wrap=True)
branch_2 = BranchByIndex(Tree=item_23, Branch=item_24)
int_2 = Integer(branch_2)
avr_3 = Average(Input=int_2)
int_3 = Integer(avr_3)
panel_52 = Panel(branch_2)
concat_5 = Concatenate(FragmentA="Average perception score: ", FragmentB=int_3)

# ----
branch_3 = BranchByIndex(Tree=item_23, Branch=number_slider_5)
int_4 = Integer(branch_3)
avr_4 = Average(Input=int_4)
int_5 = Integer(avr_4)
concat_6 = Concatenate(FragmentA="Average perception score: ", FragmentB=int_5)

texttoscreen_9 = RenderTextToScreen(Text=concat_6, Location="900,880", Size=12, Color=swatch_11, m_scWithvp=False)

# ---- group: Color selected path and cylinder
item_25 = ListItem(List=gradient, Index=item_24, Wrap=True)
argb_2 = SplitARGB(Colour=item_25, IntegerChannels=True)  # -> Alpha, Red, Green, Blue
rgb_2 = ColourRGB(Alpha=Slider(124, range=0..255), Red=argb_2.Red, Green=argb_2.Green, Blue=argb_2.Blue)

# ---- group: Node selection / Select cylinder
dispatch_15 = Dispatch(List=dispatch_2.ListA, DispatchPattern=smaller.SmallerThan)  # -> ListA, ListB
item_26 = ListItem(List=dispatch_15.ListA, Index=0, Wrap=True)
nullrep_7 = ReplaceNulls(Items=item_26, Replacements="No image")  # -> flatten(Items), Count
node_selection = Slider(14, range=0..100)
item_27 = ListItem(List=nullrep_7.Items, Index=n_shortest_routes.RouteIndices, Wrap=True)
branch_4 = BranchByIndex(Tree=item_27, Branch=item_24)
item_28 = ListItem(List=branch_4, Index=node_selection, Wrap=invert(True))

# ----
entwine = Entwine(
    Branch0X=item_19,
    Branch1X=item_17,
    Branch2X=item_23,
    Branch3X=item_13,
    Branch4X=item_15,
    Branch5X=item_11,
    FlattenInputs=False)  # -> simplify(Result)
panel_53 = Panel(entwine)
panel_54 = Panel(item_23)
data_trees_to_json_2 = DataTreesToJSON(Keys_tree=graft, Values_tree=entwine)  # -> Status, JSONPath

# ---- group: Pulse curve
branch_5 = BranchByIndex(Tree=n_shortest_routes.RouteIndices, Branch=item_24)
dom = ConstructDomain(DomainStart=0, DomainEnd=Slider(50, range=0..100))
remap = RemapNumbers(Value=branch_2, Source="0 to 100", Target=dom)  # -> Mapped, Clipped
item_29 = ListItem(List=crv_4, Index=branch_5, Wrap=True)
Z = UnitZ(Factor=remap.Mapped)
midpt_2 = CurveMiddle(Curve=item_29)
move_2 = Move(Geometry=midpt_2, Motion=Z)  # -> Geometry, Transform
swatch_13 = ColourSwatch(SwatchColor=RGB(255, 255, 0))
pline_3 = PolyLine(Vertices=move_2.Geometry, Closed=False)
previewlw_6 = CustomPreviewLineweights(Geometry=pline_3, Shader=swatch_13, Thickness=Slider(1, range=0..10), Absolute=False)

# ----
concat_7 = Concatenate(FragmentA="Selected node: ", FragmentB=node_selection)
texttoscreen_10 = RenderTextToScreen(Text=concat_7, Location="500,940", Size=12, Color=swatch_13, m_scWithvp=False)

gemini = LLMGemini(
    Api=file,
    Model="gemini-3.8-flash",
    System_prompt=panel_12,
    User_prompt=concat_4,
    Json_input=data_trees_to_json_2.JSONPath,
    As_json=toggle,
    Run=Button())  # -> Status, Json_file, Response

# ---- group: Display perception score on selected node
item_30 = ListItem(List=branch_2, Index=node_selection, Wrap=True)
concat_8 = Concatenate(FragmentA="Perception score @ selected node: ", FragmentB=item_30)

# ----
json_contents_2 = JSONContents(File_path=gemini.Json_file)
panel_55 = Panel(gemini.Status)
panel_56 = Panel(gemini.Response)

# ---- group: Display perception score on selected node
texttoscreen_11 = RenderTextToScreen(Text=concat_8, Location="900,970", Size=12, Color=swatch_13, m_scWithvp=False)

# ---- group: perception scores
texttoscreen_12 = RenderTextToScreen(Text=concat_5, Location="900,940", Size=12, Color=swatch_9, m_scWithvp=False)

# ----
panel_57 = Panel(json_contents_2)

# ---- group: node display
Z_2 = UnitZ(Factor=Slider(-10, range=-10..10))
move_3 = Move(Geometry=move_2.Geometry, Motion=Z_2)  # -> Geometry, Transform
listdexs_2 = ListIndices(List=move_3.Geometry)
concat_9 = Concatenate(FragmentA="node", FragmentB=listdexs_2, JoinSeparator=" ")
tag_5 = TextTag(Location=move_3.Geometry, Text=concat_9, Colour=swatch_13)

# ---- group: Score display
Z_3 = UnitZ(Factor=Slider(10, range=0..100))
move_4 = Move(Geometry=move_2.Geometry, Motion=Z_3)  # -> Geometry, Transform
dots_3 = DotDisplay(Point=move_2.Geometry, Colour=swatch_13, Size=Slider(3, range=0..10))
tag_6 = TextTag(Location=move_4.Geometry, Text=branch_2, Colour=swatch_13)
tag_7 = TextTag3D(Location=move_2.Geometry, Text=branch_2, Size=Slider(23, range=0..100), Colour=swatch_13, Justification=7)

# ----
gemini_2 = LLMGemini(Api=file, Model="gemini-3.8-flash", System_prompt=panel_14, User_prompt=json_contents_2, As_json=toggle, Run=Button())  # -> Status, Json_file, Response

# ---- group: New router gets more than one optimal route (continued)
item_31 = ListItem(List=n_shortest_routes.Routes, Index=gemini_2.Response, Wrap=invert(True))

# ----
previewlw_7 = CustomPreviewLineweights(Geometry=item_31, Shader=swatch_9, Thickness="7", Absolute=False)
len_3 = Length(Curve=item_31)
path_distance_2 = Panel(len_3)
int_6 = Integer(path_distance_2)
concat_10 = Concatenate(FragmentA="Sensorial route: ", FragmentB=int_6, FragmentC="m")
crvtoscreen_4 = RenderCurveToScreen(
    Curve=item_31,
    Location="50,900",
    ScaleFactor=number_slider_2,
    Color=swatch_9,
    Thickness=number_slider_6,
    Depth="0.99",
    Fixed=True,
    m_scWithvp=False)

texttoscreen_13 = RenderTextToScreen(Text=concat_10, Location="900,910", Size=12, Color=swatch_9, m_scWithvp=False)

json_contents_3 = JSONContents(File_path=gemini_2.Json_file)
panel_58 = Panel(gemini_2.Status)
panel_59 = Panel(gemini_2.Response)
panel_60 = Panel(json_contents_3)
concat_11 = Concatenate(FragmentA=directory, FragmentB=item_28)
path_5 = FilePath(concat_11)

# ---- group: Flat dot image sampling
number_slider_8 = Slider(100, range=1..200)
planesrf = PlaneSurface(Plane=PlaneXY(0, 0, 0), XSize="-40, 40", YSize=Domain(-10, 10))
division = Division(A=number_slider_8, B="4")
sdivide = DivideSurface(Surface=reparameterize(planesrf), UCount=number_slider_8, VCount=division)  # -> flatten(Points), Normals, flatten(Parameters)
filepath_for_image_sampler = Python3Script(file_path=path_5, sampler_name="sampler_flat")  # inputs file_path: String
# ---------- filepath_for_image_sampler: Python ----------
import Grasshopper as gh
import System.Reflection as reflection
import os

doc = ghenv.Component.OnPingDocument()

if file_path and os.path.exists(file_path):
    for obj in doc.Objects:
        if isinstance(obj, gh.Kernel.Special.GH_ImageSampler) and obj.NickName == sampler_name:
            if obj.ImageFilePath != file_path:
                # 1. Set new file path string
                obj.ImageFilePath = file_path
                
                # 2. Force reload of the internal bitmap memory cache using Reflection
                flags = reflection.BindingFlags.Instance | reflection.BindingFlags.NonPublic | reflection.BindingFlags.Public
                method = obj.GetType().GetMethod("LoadImage", flags) or obj.GetType().GetMethod("ReloadImage", flags)
                
                if method:
                    method.Invoke(obj, None)
                
                # 3. Re-evaluate downstream Grasshopper components
                obj.ExpireSolution(True)
            break
# ---------- end filepath_for_image_sampler ----------
sampler_flat = ImageSampler(
    sdivide.Parameters,
    FilePath="C:\Users\l03063058\Desktop\Github\DRVaa\streetview_panoramas_360\QdDAaM63PhkGI2r2wJuS9w_360.jpg",
    Filter="Colour",
    Interpolate=False,
    Umax=1,
    Umin=0,
    Vmax=1,
    Vmin=0,
    Wrap=1)

# ----
panel_61 = Panel(path_5)
render_image_to_screen = Python3Script(file_path=path_5, screen_x="1300", screen_y="680", scale="0.2", enabled=Toggle(True))  # inputs file_path: String, screen_x: Int32, screen_y: String, scale: Double, enabled: Boolean
# ---------- render_image_to_screen: Python ----------
import Rhino
import System.Drawing as drawing
import scriptcontext as sc
import os

class ImageConduit(Rhino.Display.DisplayConduit):
    def __init__(self, path, x, y, scale_factor=1.0):
        super().__init__()
        self.x = int(x)
        self.y = int(y)
        self.display_bmp = None
        self.scaled_bmp = None
        self.sys_bmp = None
        
        if path and os.path.exists(path):
            try:
                # Load system bitmap
                self.sys_bmp = drawing.Bitmap(path)
                
                # Compute resampled dimensions
                sf = max(0.01, float(scale_factor))
                w = max(1, int(self.sys_bmp.Width * sf))
                h = max(1, int(self.sys_bmp.Height * sf))
                
                # Create scaled system bitmap
                self.scaled_bmp = drawing.Bitmap(self.sys_bmp, w, h)
                
                # Generate GPU-compatible DisplayBitmap
                self.display_bmp = Rhino.Display.DisplayBitmap(self.scaled_bmp)
            except Exception as ex:
                print("Error loading bitmap:", ex)

    def CalculateBoundingBox(self, e):
        super().CalculateBoundingBox(e)
        # Force pipeline execution even when 3D geometry is absent
        e.IncludeBoundingBox(Rhino.Geometry.BoundingBox(Rhino.Geometry.Point3d(-10, -10, -10), Rhino.Geometry.Point3d(10, 10, 10)))

    def DrawForeground(self, e):
        # Draw directly in screen pixel space (top-left origin = 0,0)
        if self.display_bmp:
            e.Display.DrawBitmap(self.display_bmp, self.x, self.y)

    def Dispose(self):
        if self.display_bmp:
            self.display_bmp.Dispose()
            self.display_bmp = None
        if self.scaled_bmp:
            self.scaled_bmp.Dispose()
            self.scaled_bmp = None
        if self.sys_bmp:
            self.sys_bmp.Dispose()
            self.sys_bmp = None

# --- CONDUIT MANAGEMENT ---
# Clear existing conduit instance from persistent sticky memory
if "image_conduit" in sc.sticky and sc.sticky["image_conduit"] is not None:
    old_conduit = sc.sticky["image_conduit"]
    old_conduit.Enabled = False
    try:
        old_conduit.Dispose()
    except Exception:
        pass
    sc.sticky["image_conduit"] = None

# Safely extract component inputs
run_enabled = globals().get('enabled', True)
path_val = globals().get('file_path', None)
x_val = globals().get('screen_x', 50)
y_val = globals().get('screen_y', 50)
scale_val = globals().get('scale', 1.0)

# Strip surrounding quotes if path was passed as a literal string
if path_val and isinstance(path_val, str):
    path_val = path_val.strip('\'"')

# Enable new conduit if file path exists
if run_enabled and path_val and os.path.exists(path_val):
    conduit = ImageConduit(path_val, x_val, y_val, scale_val)
    conduit.Enabled = True
    sc.sticky["image_conduit"] = conduit

# Force active viewport redraw
if Rhino.RhinoDoc.ActiveDoc:
    Rhino.RhinoDoc.ActiveDoc.Views.Redraw()
# ---------- end render_image_to_screen ----------

# ---- group: Flat dot image sampling
ahsv = SplitAHSV(Colour=sampler_flat)  # -> Alpha, Hue, Saturation, Value
sort_2 = SortList(Keys=ahsv.Hue, ValuesA=ahsv.Saturation, ValuesB=ahsv.Value)  # -> Keys, ValuesA, ValuesB
hsv = ColourHSV(Alpha=1, Hue=sort_2.Keys, Saturation=sort_2.ValuesA, Value=sort_2.ValuesB)
dots_4 = DotDisplay(Point=sdivide.Points, Colour=hsv, Size=Slider(0.4, range=0..1))
pttoscreen = RenderPointToScreen(
    Point=sdivide.Points,
    Location="1555,930",
    ScaleFactor=Slider(6.4, range=0..10),
    Color=hsv,
    Radius=Slider(2, range=0..10),
    Depth="1",
    Fixed=True,
    m_scWithvp=False)

# ---- group: Selected path division and cylinder
ln = Line(StartPoint=midpt_2, EndPoint=move_2.Geometry)
end = EndPoints(Curve=ln)  # -> Start, End
cir = Circle(Plane=end.End, Radius=Slider(70, range=0..100))
Z_4 = UnitZ(Factor=Slider(40, range=0..100))
extr = Extrude(Base=cir, Direction=Z_4)
item_32 = ListItem(List=extr, Index=node_selection, Wrap=True)
preview_2 = CustomPreview(Geometry=item_32, Material=ColourSwatch(SwatchColor=RGBA(255, 255, 255, 126)))

# ----
item_33 = ListItem(List=ln, Index=node_selection, Wrap=True)

# ---- group: Selected path division and cylinder (continued)
previewlw_8 = CustomPreviewLineweights(Geometry=item_33, Shader=swatch_13, Thickness="3", Absolute=False)

# ---- group: Dot image sampling
cylinder = Surface(reparameterize(item_32))  # disabled
number_slider_9 = Slider(200, range=1..200)
division_2 = Division(A=number_slider_9, B="10")
filepath_for_image_sampler_2 = Python3Script(file_path=path_5, sampler_name="sampler_cylinder")  # inputs file_path: String; same code as filepath_for_image_sampler
toggle_2 = GroupToggle(ToggleActive=True, ToggleVisible=False)  # disabled

# ----
transpose = TransposeSurface(Surface=cylinder)  # -> Surface, U, V

# ---- group: Dot image sampling (continued)
sdivide_2 = DivideSurface(Surface=reparameterize(transpose.Surface), UCount=number_slider_9, VCount=division_2)  # -> flatten(Points), Normals, flatten(Parameters)
sampler_cylinder = ImageSampler(
    sdivide_2.Parameters,
    FilePath="C:\Users\l03063058\Desktop\Github\DRVaa\streetview_panoramas_360\QdDAaM63PhkGI2r2wJuS9w_360.jpg",
    Filter="Colour",
    Interpolate=False,
    Umax=1,
    Umin=0,
    Vmax=1,
    Vmin=0,
    Wrap=0)
argb_3 = SplitARGB(Colour=sampler_cylinder, IntegerChannels=True)  # -> Alpha, Red, Green, Blue
rgb_3 = ColourRGB(Alpha=Slider(100, range=1..255), Red=argb_3.Red, Green=argb_3.Green, Blue=argb_3.Blue)  # -> simplify(Colour)
dots_5 = DotDisplay(Point=sdivide_2.Points, Colour=rgb_3, Size=1)
