# Grasshopper definition atmosphericScore-amenities.gh (Grasshopper 1.0.8)
# plug-ins: Urbano, Human

# ----
# 1. OSM
path = FilePath("C:\Users\l03063058\Desktop\Github\DRVaa\Grasshopper\cityModels\SJO_match_large.osm")
importosm = ImportOSMFeatures(OSMPathOrURL=path, OSMFeatureType="street", Format="xml", ImportAltitude=False)  # -> Points, Metadata, UTMZone, TranslationVector
importosm_2 = ImportOSMFeatures(OSMPathOrURL=path, OSMFeatureType="amenity", Format="xml", ImportAltitude=False)  # -> Points, Metadata, UTMZone, TranslationVector
importosm_3 = ImportOSMFeatures(OSMPathOrURL=path, OSMFeatureType="building", Format="xml", ImportAltitude=False)  # -> Points, Metadata, UTMZone, TranslationVector
pline = PolyLine(Vertices=importosm.Points, Closed=False)
pline_2 = PolyLine(Vertices=importosm_3.Points, Closed=invert(False))  # -> flatten(Polyline)
streetnet = CreateStreetNetwork(
    StreetCurves=flatten(pline),
    Metadata=flatten(importosm.Metadata),
    SplitStreetCurves=False,
    UTMZone=importosm.UTMZone,
    TranslationVector=importosm.TranslationVector)  # -> StreetNetwork, StreetSegmentCurves, UTMZone, TranslationVector
amen = CreateAmenity(PointLocationOfAmenity=importosm_2.Points, Metadata=importosm_2.Metadata)
lookup = LookupMetadata(MetadataGeometry=importosm_2.Metadata, SearchKey="amenity")
demeta = DeconstructMetadata(Metadata=amen)  # -> Keys, Values
bldg = CreateBuilding(Metadata=importosm_3.Metadata, AmenitiesInBuilding=amen)
model = BuildUrbanoModel(Buildings=flatten(bldg), StreetNetwork=streetnet.StreetNetwork, BuildToggle=True)  # -> UrbanoModel, BuildingCurves, Activities
panel = Panel(lookup)
panel_2 = Panel(model.Activities)
inbldg = InspectBuilding(Building=bldg, UrbanoModel=model.UrbanoModel, DefaultHeight=10)  # -> Geometry, Metadata, Amenity, BuildingMesh
panel_3 = Panel(demeta.Keys)
findamen = FindAmenities(UrbanoModel=model.UrbanoModel, Activity=model.Activities)
panel_4 = Panel(demeta.Values)
panel_5 = Panel(findamen)
panel_6 = Panel(inbldg.Amenity)
preview = CustomPreview(
    Geometry=inbldg.BuildingMesh,
    Material={diffuse=RGB(221, 160, 221), emission=RGB(66, 48, 66), shine=0.5, specular=RGB(255, 255, 255), transparency=0})
item = ListItem(List=flatten(inbldg.BuildingMesh), Index=Slider(1, range=0..1000), Wrap=True)

# ---- group: LA-Downtown
path_2 = FilePath("C:\Users\l03063058\Desktop\Github\DRVaa\Grasshopper\cityModels\SJO_match_large.osm")  # disabled

# ---- group: DLA01
path_3 = FilePath("C:\Users\l03063058\Downloads\map.osm")  # disabled

# ----
cluster = Cluster(url=path_3)  # -> building, street_network, street_segment_curves; disabled
model_2 = BuildUrbanoModel(Buildings=flatten(cluster.building), StreetNetwork=cluster.street_network, BuildToggle=True)  # -> UrbanoModel, BuildingCurves, Activities; disabled
inbldg_2 = InspectBuilding(Building=model_2.BuildingCurves, DefaultHeight=10)  # -> Geometry, Metadata, Amenity, graft(BuildingMesh); disabled
geo = Geometry(inbldg_2.Geometry)  # disabled
panel_7 = Panel("name")  # disabled
demeta_2 = DeconstructMetadata(Metadata=inbldg_2.Metadata)  # -> Keys, Values; disabled
# 3. Metadata
cset = CreateSet(List=flatten(demeta_2.Keys))  # -> Set, Map; disabled
tsort = SortText(Keys=cset.Set, Culture=127)  # -> Keys, Values; disabled
area = Area(Geometry=inbldg_2.Geometry)  # -> Area, graft(Centroid); disabled
panel_8 = Panel(tsort.Keys)  # disabled
tmatch = MatchText(Text=demeta_2.Keys, Pattern=panel_7, Case=invert(True))  # disabled
pt = Point(area.Centroid)  # disabled
number_slider = Slider(2024, range=1800..2024)  # disabled
dispatch = Dispatch(List=demeta_2.Values, DispatchPattern=tmatch)  # -> ListA, ListB; disabled
swatch = ColourSwatch(SwatchColor=RGB(25, 255, 255))  # disabled
panel_9 = Panel("black")  # disabled
panel_10 = Panel(dispatch.ListA)  # disabled
panel_11 = Panel(demeta_2.Values)  # disabled
tag = TextTag(Location=area.Centroid, Text=dispatch.ListA, Colour=swatch)  # disabled
smaller = SmallerThan(FirstNumber=dispatch.ListA, SecondNumber=number_slider)  # -> SmallerThan, OrEqualTo; disabled
larger = LargerThan(FirstNumber=dispatch.ListA, SecondNumber=number_slider)  # -> LargerThan, OrEqualTo; disabled
number_slider_2 = Slider(263, range=0..1000)  # disabled
dispatch_2 = Dispatch(List=inbldg_2.BuildingMesh, DispatchPattern=smaller.SmallerThan)  # -> ListA, ListB; disabled
number_slider_3 = Slider(100, range=0..100)  # disabled
panel_12 = Panel("200,200,0")  # disabled
fonts = FontTable()  # disabled
swatch_2 = ColourSwatch(SwatchColor=RGB(183, 21, 60))  # disabled
panel_13 = Panel("consolas")  # disabled
mesh = Mesh(dispatch_2.ListA)  # disabled
swatch_3 = ColourSwatch(SwatchColor=RGB(255, 0, 119))  # disabled
preview_2 = CustomPreview(Geometry=mesh, Material=swatch_3)  # disabled
texttoscreen = RenderTextToScreen(Text=number_slider, Location=panel_12, Size=number_slider_3, Color=swatch_2, Font=panel_13, m_scWithvp=False)  # disabled
item_2 = ListItem(List=fonts, Index=number_slider_2, Wrap=True)  # disabled
panel_14 = Panel(fonts)  # disabled

panel_15 = Panel("2787")
urbano_model = Relay()
activities = Relay()

panel_16 = Panel(activities)
item_3 = ListItem(List=activities, Index=Slider(12, range=0..100), Wrap=True)

cull_i = CullIndex(List=pline_2, Indices="2787", Wrap=True)

panel_17 = Panel("fast_food")
panel_18 = Panel("library")
panel_19 = Panel("restaurant")

pt_2 = Point(importosm_2.Points)
crv = Curve(inbldg.Geometry)

# ----
# 2. Usos
panel_20 = Panel(path_2)  # disabled
cluster_2 = Cluster(url=path_2)  # -> building, street_network, street_segment_curves; disabled
model_3 = BuildUrbanoModel(Buildings=flatten(cluster_2.building), StreetNetwork=cluster_2.street_network, BuildToggle=True)  # -> UrbanoModel, BuildingCurves, Activities; disabled
panel_21 = Panel(activities)
txt = Text(panel_16)
lng = ListLength(List=txt)
random = Random(Range=Domain(0, 1), Number=lng, Seed=2)
gradient = Gradient(
    LowerLimit=0,
    UpperLimit=1,
    Parameter=random,
    stops=[0: RGB(243, 57, 0), 0.1: RGB(236, 27, 60), 0.2: RGB(210, 0, 118), 0.3: RGB(103, 0, 120), 0.4: RGB(39, 72, 161), 0.5: RGB(1, 192, 229), 0.6: RGB(18, 178, 90), 0.7: RGB(79, 186, 8), 0.8: RGB(220, 237, 32), 0.9: RGB(247, 159, 20), 1: RGB(243, 57, 0)])
col = Colour(simplify(graft(gradient)))

# ---- group: Inspect Amenities
findamen_2 = FindAmenities(UrbanoModel=urbano_model, Activity=txt)
inamen = InspectAmenity(Amenity=findamen_2)  # -> Name, Activities, Host, Metadata

# ----
panel_22 = Panel(inamen.Metadata)

# ---- group: Inspect Buildings
inbldg_3 = InspectBuilding(Building=inamen.Host, DefaultHeight=10)  # -> Geometry, Metadata, Amenity, simplify(BuildingMesh)

# ----
srf = Surface(inbldg_3.Geometry)

preview_3 = CustomPreview(Geometry=inbldg_3.BuildingMesh, Material=col)

# ==== cluster Cluster
url = ClusterInput()
# URL / File Path
url_2 = Text(url)

# ---- group: Import Geometries
import_osm_features = ImportOSMFeatures(OSMPathOrURL=url_2, OSMFeatureType="street", Format="xml", ImportAltitude=False)  # -> Points, Metadata, UTMZone, TranslationVector
import_osm_features_2 = ImportOSMFeatures(OSMPathOrURL=url_2, OSMFeatureType="building", Format="xml", ImportAltitude=False)  # -> Points, Metadata, UTMZone, TranslationVector
import_osm_features_3 = ImportOSMFeatures(OSMPathOrURL=url_2, OSMFeatureType="amenity", Format="xml", ImportAltitude=False)  # -> Points, Metadata, UTMZone, TranslationVector

# ---- group: Add Amenity Capacity
lookup_metadata = LookupMetadata(MetadataGeometry=import_osm_features_3.Metadata, SearchKey="amenity")
amenity_capacity = AmenityCapacity(
    Activity=lookup_metadata,
    Area=-1,
    LogisticsAreaProportion=0.2,
    AmenityCapacityData="""post_office, 5, 15
bank, 5, 15
cinema, 1, 248
theatre, 1, 215
arts_centre, 3, 20
department_store, 1, 78
supermarket_store, 2, 32
convenience_store, 1, 39
hardware_store, 1, 50
pharmacy, 1, 42
restaurant, 2, 35
fast_food, 1, 36
cafe, 1, 50
bar, 1, 47
pub, 1, 47
clothes_store, 2, 21
books_store, 1, 26
beauty_store, 1, 27
shoes_store, 1, 38""")
merge_metadata = MergeMetadata(Metadata=amenity_capacity, Metadata_2=import_osm_features_3.Metadata)

# ---- group: Build Basic Model
polyline = PolyLine(Vertices=import_osm_features_2.Points, Closed=False)
polyline_2 = PolyLine(Vertices=import_osm_features.Points, Closed=False)
create_amenity = CreateAmenity(PointLocationOfAmenity=import_osm_features_3.Points, Metadata=merge_metadata)
create_street_network = CreateStreetNetwork(
    StreetCurves=flatten(polyline_2),
    Metadata=flatten(import_osm_features.Metadata),
    SplitStreetCurves=True,
    UTMZone=import_osm_features.UTMZone,
    TranslationVector=import_osm_features.TranslationVector)  # -> StreetNetwork, StreetSegmentCurves, UTMZone, TranslationVector
arrange_amenities_by_building = ArrangeAmenitiesByBuilding(Amenities=flatten(create_amenity), Buildings=flatten(polyline))  # -> AmenitiesByBuilding, Buildings
create_building = CreateBuilding(
    BuildingCurve=arrange_amenities_by_building.Buildings,
    Metadata=import_osm_features_2.Metadata,
    AmenitiesInBuilding=arrange_amenities_by_building.AmenitiesByBuilding)

# ----
street_network = ClusterOutput(create_street_network.StreetNetwork)
street_segment_curves = ClusterOutput(create_street_network.StreetSegmentCurves)
building = ClusterOutput(create_building)
