# Grasshopper definition dataframes_reading.gh (Grasshopper 1.0.8)
# plug-ins: CORE.Toolbox.Grasshopper, Urbano, Human, MetaHopper

# ---- group: INPUT
path = FilePath("C:\Users\l03063058\Desktop\Github\DRVaa\Grasshopper\cityModels\SJO_match_large.osm")
panel = Panel(path)

# ----
# URBANO 1
panel_2 = Panel(path)

# ---- group: CSV file with perception data for each street segment (through LLM or participatory design)
path_2 = FilePath("C:\Users\l03063058\Desktop\Github\DRVaa\street_segments_scored_360.csv")

# ----
panel_3 = Panel(path_2)

importosm = ImportOSMFeatures(OSMPathOrURL=path, OSMFeatureType="building", Format="xml", ImportAltitude=False)  # -> Points, Metadata, UTMZone, TranslationVector
importosm_2 = ImportOSMFeatures(OSMPathOrURL=path, OSMFeatureType="street", Format="xml", ImportAltitude=False)  # -> Points, Metadata, UTMZone, TranslationVector
importosm_3 = ImportOSMFeatures(OSMPathOrURL=path, OSMFeatureType="amenity", Format="xml", ImportAltitude=False)  # -> Points, Metadata, UTMZone, TranslationVector
pline = PolyLine(Vertices=importosm.Points, Closed=False)
pline_2 = PolyLine(Vertices=importosm_2.Points, Closed=False)
amen = CreateAmenity(PointLocationOfAmenity=importosm_3.Points, Metadata=importosm_3.Metadata)
streetnet = CreateStreetNetwork(
    StreetCurves=flatten(pline_2),
    Metadata=flatten(importosm_2.Metadata),
    SplitStreetCurves=True,
    UTMZone=importosm_2.UTMZone,
    TranslationVector=importosm_2.TranslationVector)  # -> StreetNetwork, StreetSegmentCurves, UTMZone, TranslationVector
bldg = CreateBuilding(BuildingCurve=pline, Metadata=importosm.Metadata, AmenitiesInBuilding=amen)
model = BuildUrbanoModel(Buildings=flatten(bldg), StreetNetwork=streetnet.StreetNetwork, BuildToggle=False)  # -> UrbanoModel, BuildingCurves, Activities
inbldg = InspectBuilding(Building=bldg, UrbanoModel=model.UrbanoModel, DefaultHeight=10)  # -> Geometry, Metadata, Amenity, flatten(BuildingMesh)

panel_4 = Panel("C:\Users\l03063058\OneDrive - Instituto Tecnologico y de Estudios Superiores de Monterrey\TEC stuff\RESEARCH\02_architecturalIntelligence\02_general analysis\SHP files\perception.shp")

# ---- group: CSV to SHP v003
py3 = Python3Script(csv_file=path_2, shp_file_path=panel_4)  # -> GeoDataFrame, shp_file
#   port csv_file: CSV file with perception data (machine or human) for each street segment. File should include columns named latitude and longitude so it can georeference each street segment and convert to SHP file.
#   port shp_file_path: Select file path where SHP file will be saved.
# ---------- py3: Python ----------
#! python3
#r: pandas, geopandas

import pandas as pd
import geopandas as gpd
from shapely.geometry import Point

# Read CSV file
df = pd.read_csv(csv_file)


# Make sure CSV file has columns for latitud and longitud
# if 'latitude' not in df.columns or 'longitude' not in df.columns:
    # raise ValueError("CSV file must have 'latitude' and 'longitude' columns")
    

# Create point geometry based on coordinates
geometry = [Point(xy) for xy in zip(df['longitude'], df['latitude'])]
gdf = gpd.GeoDataFrame(df, geometry=geometry)

# Establish reference system (CRS), WGS84 for example
gdf.set_crs(epsg=4326, inplace=True)

# Display dataframe
GeoDataFrame = gdf

# Save as Shapefile
gdf.to_file(shp_file_path)

shp_file = shp_file_path

# print(GeoDataFrame.crs)
# ---------- end py3 ----------

# ----
panel_5 = Panel(py3.GeoDataFrame)

# ---- group: SHP to GeoDataframe
py3_2 = Python3Script(SHP=py3.shp_file)  # -> GeoDataFrame
# ---------- py3_2: Python ----------
#! python3
#r: geopandas


#THIS IS NECESSARY TO LOAD PANDAS otherwise it bugs
import locale
locale.setlocale(locale.LC_ALL, 'en_US')

import geopandas as gpd

GeoDataFrame = gpd.read_file(SHP)
# ---------- end py3_2 ----------

# ---- group: RESULTADOS / Huellas de edificios
crv = Curve(inbldg.Geometry)

# ---- group: RESULTADOS / Volumetrías
geo = Geometry(inbldg.BuildingMesh)

# ---- group: RESULTADOS / Red de calles
crv_2 = Curve(streetnet.StreetSegmentCurves)

# ---- group: Dataframe Details
py3_3 = Python3Script(dataFrame=py3_2)  # -> info, column_name, head_x10, tail_x10, shape, number_of_null_values
# ---------- py3_3: Python ----------
info = dataFrame.info

head_x10 = dataFrame.head(10)
tail_x10 = dataFrame.tail(10)
shape = dataFrame.shape

#Add up all null values
number_of_null_values = dataFrame.isnull().sum()



# columns = dataFrame.columns
# Get the columns as a list
column_name = dataFrame.columns.tolist()

# Output the list
# print(column_name)
# ---------- end py3_3 ----------

# ----
panel_6 = Panel(py3_3.column_name)
item = ListItem(List=py3_3.column_name, Index=Slider(11, range=0..42), Wrap=True)

# ---- group: attach to edges / insert street segments
crv_3 = Curve(streetnet.StreetSegmentCurves)

# ---- group: attach to edges / distance threshold
number_slider = Slider(5, range=0..100)

# ----
# Perception (9s)
bounding_box = Relay()
toggle = GroupToggle(ToggleActive=True, ToggleVisible=False)  # disabled

# ----
# LLM Walkability Perception
panel_7 = Panel(py3_3.head_x10)
importshp = ImportShapefileFeatures(
    ShapefilePath=py3.shp_file,
    Reproject=False,
    UTMZone=importosm_2.UTMZone,
    TranslationVector=importosm_2.TranslationVector,
    CroppingGeometry=bounding_box)  # -> simplify(flatten(Points)), Metadata, UTMZone, TranslationVector
demeta = DeconstructMetadata(Metadata=importshp.Metadata)  # -> Keys, Values
panel_8 = Panel(demeta.Values)
panel_10 = Panel(demeta.Keys)

panel_11 = Panel(importshp.Points)
lookup = LookupMetadata(MetadataGeometry=importshp.Metadata, SearchKey=item)

trim = TextTrim(Start=True, End=True)

# ---- group: Column Values 001
py3_4 = Python3Script(dataFrame=py3.GeoDataFrame, column_name="acoustic_comfort")  # -> columnValues
# ---------- py3_4: Python ----------
columnValues = dataFrame[column_name].tolist()
# ---------- end py3_4 ----------

# ----
panel_12 = Panel(py3_4)

viewer = ParamViewer(py3_4)
split = TextSplit(Text=py3_4, Separators="**Overall Walkability: 65**")

# ----
# FILTERING
number_slider_2 = Slider(9, range=0..42)
item_2 = ListItem(List=py3_3.column_name, Index=number_slider_2, Wrap=True)
lookup_2 = LookupMetadata(MetadataGeometry=importshp.Metadata, SearchKey=item_2)
pt = Point(flatten(importshp.Points))

num = Number(lookup_2)

round = Round(Number=num)  # -> Nearest, Floor, Ceiling
dots = DotDisplay(Point=pt, Colour=ColourSwatch(SwatchColor=RGB(238, 95, 131)), Size=Slider(5, range=0..20))
dup_pts = CleanDuplicatePoints(Points=pt, Tolerance=0.01)  # -> Points, Indices, Status
dispatch = Dispatch(List=round.Nearest, DispatchPattern=dup_pts.Status)  # -> ListA, ListB
panel_13 = Panel(dispatch.ListA)

points = PointList(Points=pt, Size=Slider(6, range=0..10))

tag = TextTag(Location=flatten(dup_pts.Points), Text=dispatch.ListA, Colour=ColourSwatch(SwatchColor=RGB(0, 0, 0)))

# ---- group: attach to edges / Insert points
pt_2 = Point(dup_pts.Points)

# ---- group: attach to edges
tag_2 = TextTag(Location=pt_2, Text=dispatch.ListA)
midpt = CurveMiddle(Curve=crv_3)
pull = PullPoint(Point=pt_2, Geometry=graft(midpt), ClosestOnly=True)  # -> ClosestPoint, Distance, Index
avr = Average(Input=dispatch.ListA)
number_slider_3 = Slider(2, range=0..10)
panel_15 = Panel(avr)
smaller = SmallerThan(FirstNumber=pull.Distance, SecondNumber=number_slider)  # -> SmallerThan, OrEqualTo
dispatch_2 = Dispatch(List=pull.ClosestPoint, DispatchPattern=smaller.SmallerThan)  # -> ListA, ListB
dispatch_3 = Dispatch(List=dispatch.ListA, DispatchPattern=smaller.SmallerThan)  # -> ListA, ListB
points_2 = PointList(Points=flatten(midpt), Size=number_slider_3)
pt_3 = Point(dispatch_2.ListA)
points_3 = PointList(Points=flatten(pt_3), Size=number_slider_3)
panel_16 = Panel(pt_3)

# ---- group: attach to edges / Output: reordered data
data = Data(dispatch_3.ListA)

# ---- group: attach to edges (continued)
item_3 = ListItem(List=data, Index=0, Wrap=True)
item_4 = ListItem(List=data, Index=0, Wrap=True)
panel_17 = Panel(item_3)
bnd = Bounds(Numbers=flatten(item_3))
nullrep = ReplaceNulls(Items=item_3, Replacements="0")  # -> flatten(Items), Count
tag_3 = TextTag(Location=midpt, Text=flatten(nullrep.Items))
dedomain = DeconstructDomain(Domain=bnd)  # -> Start, End
gradient = Gradient(
    LowerLimit=Slider(100, range=0..100),
    UpperLimit=Slider(0, range=0..100),
    Parameter=nullrep.Items,
    stops=[0: RGB(244, 75, 29), 0: RGB(0, 128, 0), 0.00375: RGB(255, 0, 0), 0.489: RGB(255, 165, 0), 1: RGB(0, 191, 255)])
panel_18 = Panel(nullrep.Items)
col = Colour(gradient)
panel_19 = Panel(col)
previewlw = CustomPreviewLineweights(Geometry=crv_3, Shader=col, Thickness=Slider(3, range=0..10), Absolute=False)
