# Grasshopper definition xRouter01.gh (Grasshopper 1.0.8)
# plug-ins: CORE.Toolbox.Grasshopper, Urbano2, Urbano, Human

geographic_boundary = GeographicBoundary(Left="-118.261245", Top="34.053051", Right="-118.244401", Bottom="34.044979")  # -> Boundary, CoordinateReference
path = FilePath("C:\Users\l03063058\OneDrive - Instituto Tecnologico y de Estudios Superiores de Monterrey\TEC stuff\RESEARCH\10_experienceRouter\04_tool\01_DRVaa\Grasshopper\")
create_project_setting = CreateProjectSetting(
    Directory=path,
    Boundary=geographic_boundary.Boundary,
    Granularity="Tract",
    DataLayers="All",
    CoordinateReference=geographic_boundary.CoordinateReference)
osm_feature_query = OsmFeatureQuery(OsmFeatureQuery=["building=*", "building:part=*", "building:parts=*"])
osm_feature_query_2 = OsmFeatureQuery(OsmFeatureQuery=["highway=motorway", "highway=trunk", "highway=primary", "highway=secondary", "highway=tertiary", "highway=unclassified", "highway=residential", "highway=service", "highway=motorway_link", "highway=trunk_link", "highway=primary_link", "highway=secondary_link", "highway=motorway_junction", "highway=yes", "highway=road", "highway=living street", "highway=footway", "highway=pedestrian", "highway=path", "highway=bridleway", "highway=cycleway", "highway=raceway", "highway=steps"])
panel = Panel(create_project_setting)
# Click this button to
# start generating your own
# project setting string
toggle = BooleanToggle(True)
osm_feature_query_3 = OsmFeatureQuery(OsmFeatureQuery=["building=*", "building:part=*", "building:parts=*"])
osm_feature_query_4 = OsmFeatureQuery(OsmFeatureQuery=["highway=motorway", "highway=trunk", "highway=primary", "highway=secondary", "highway=tertiary", "highway=unclassified", "highway=residential", "highway=service", "highway=motorway_link", "highway=trunk_link", "highway=primary_link", "highway=secondary_link", "highway=motorway_junction", "highway=yes", "highway=road", "highway=living street", "highway=footway", "highway=pedestrian", "highway=path", "highway=bridleway", "highway=cycleway", "highway=raceway", "highway=steps"])
path_2 = FilePath("C:\Users\l03063058\Desktop\tec_lo.osm")  # disabled
route_biases = RouteBiases()  # -> RouteBias, Point, CoordinateReference
workflow_template = WorkflowTemplate()  # -> Directories, Templates, ExampleProjectSetting, ExampleOSMFilePath, ExampleShapefilePath, ExampleGeojsonPath
path_3 = FilePath("C:\Users\l03063058\OneDrive - Instituto Tecnologico y de Estudios Superiores de Monterrey\TEC stuff\RESEARCH\10_experienceRouter\04_tool\01_DRVaa\Grasshopper\mapLA.osm")
project_setting = ProjectSetting(Run=toggle, ProjectSettingCache="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")
import_osm_file = ImportOSMFile(OsmFilePath=path_3, OsmFeatures=osm_feature_query, Terrain=False, Run=True)  # -> Polylines, Polygons, Points, CoordinateReference, Boundary
import_buildings = ImportBuildings(DataSource="osm", Terrain=False)  # -> _2DFootprints, _3DMeshes
importosm = ImportOSMFeatures(OSMPathOrURL=path_2, OSMFeatureType="building", Format="xml", ImportAltitude=False)  # -> Points, Metadata, UTMZone, TranslationVector; disabled
importosm_2 = ImportOSMFeatures(OSMPathOrURL=path_2, OSMFeatureType="amenity", Format="xml", ImportAltitude=False)  # -> Points, Metadata, UTMZone, TranslationVector; disabled
importosm_3 = ImportOSMFeatures(OSMPathOrURL=path_2, OSMFeatureType="street", Format="xml", ImportAltitude=False)  # -> Points, Metadata, UTMZone, TranslationVector; disabled
meta = CreateMetadata()
draw_map = DrawMap()
panel_2 = Panel(project_setting)
import_osm_file_2 = ImportOSMFile(OsmFilePath=path_3, OsmFeatures=osm_feature_query_4, Terrain=False, Run=True)  # -> Polylines, Polygons, Points, CoordinateReference, Boundary
projbound = ProjectGeographicBoundary()  # -> Boundary, Geometry, CoordinateReference
pline = PolyLine(Vertices=importosm.Points, Closed=invert(False))  # disabled
pline_2 = PolyLine(Vertices=importosm_3.Points, Closed=False)  # disabled
street_metadata = StreetMetadata(CanWalk=True, CanBike=True, CanDrive=True)
search_metadata = SearchMetadata()
lookup = LookupMetadata(MetadataGeometry=import_osm_file.Polygons, SearchKey="Height")
bldg = CreateBuilding(BuildingCurve=pline, Metadata=importosm.Metadata)  # disabled
streetnet = CreateStreetNetwork(
    StreetCurves=flatten(pline_2),
    Metadata=flatten(importosm_3.Metadata),
    SplitStreetCurves=True,
    UTMZone=importosm_3.UTMZone,
    TranslationVector=importosm_3.TranslationVector)  # -> StreetNetwork, StreetSegmentCurves, UTMZone, TranslationVector; disabled
panel_3 = Panel(lookup)
# Replace with your
# project setting
text = Text(project_setting)
previewlw = CustomPreviewLineweights(Geometry=import_osm_file_2.Polylines, Shader=ColourSwatch(SwatchColor=RGB(215, 222, 220)), Absolute=False)
model = BuildUrbanoModel(Buildings=flatten(bldg), StreetNetwork=streetnet.StreetNetwork, BuildToggle=True)  # -> UrbanoModel, BuildingCurves, Activities; disabled
midpt = CurveMiddle(Curve=streetnet.StreetSegmentCurves)  # disabled
index = ItemIndex(List=streetnet.StreetSegmentCurves, Item=streetnet.StreetSegmentCurves)  # disabled
pt = Point(Point(596.3598875, 767.5411646, 0))
pt_2 = Point(Point(1504.957871, 1141.907495, 0))

# ---- group: New router gets more than one optimal route
n_shortest_routes = Python3Script(Lines=import_osm_file_2.Polylines, StartPt=pt, EndPt=pt_2, Penalty="10.0", K=Slider(5, range=1..20))  # -> out, Routes, RouteIndices; inputs Lines: list of Curve, StartPt: Point3d, EndPt: Point3d, Penalty: Double, K: Int32
#   port Lines: Lines to convert to network.
#   port StartPt: Origin point.
#   port EndPt: Destination point.
#   port Penalty: Edge penalization to control how drastically the routes are forced to diverge. This, at the same time, forces the algorithm to give distinctive, alternative routes. A good starting point is 10.0
#   port Routes: Generated n routes.
#   port RouteIndices: Indices for line segments within routes.
# ---------- n_shortest_routes: Python ----------
#! python 3
# r: networkx

import rhinoscriptsyntax as rs
import Rhino.Geometry as rg
import networkx as nx

# NEW: Import Grasshopper's native Data Tree modules
import Grasshopper
from Grasshopper.Kernel.Data import GH_Path
import System

def get_distinct_paths_with_indices(curves, start_pt, end_pt, k, penalty_factor):
    if isinstance(curves, rg.Curve):
        curves = [curves]
        
    G = nx.Graph()
    
    def pt_to_key(pt):
        return (round(pt.X, 3), round(pt.Y, 3), round(pt.Z, 3))
        
    edge_geometries = {}
    edge_indices = {} 
    
    print("1. Building graph...")
    for original_idx, crv in enumerate(curves):
        if not crv: continue
        
        segments_to_process = []
        if crv.IsPolyline():
            success, polyline = crv.TryGetPolyline()
            if success:
                for seg in polyline.GetSegments():
                    segments_to_process.append(rg.LineCurve(seg))
        else:
            segments_to_process.append(crv)
            
        for seg_crv in segments_to_process:
            p1 = seg_crv.PointAtStart
            p2 = seg_crv.PointAtEnd
            
            k1 = pt_to_key(p1)
            k2 = pt_to_key(p2)
            
            length = seg_crv.GetLength()
            
            G.add_edge(k1, k2, weight=length)
            
            edge_geometries[(k1, k2)] = seg_crv
            edge_geometries[(k2, k1)] = seg_crv 
            edge_indices[(k1, k2)] = original_idx
            edge_indices[(k2, k1)] = original_idx
            
    if len(G.nodes) == 0:
        print("Error: No valid lines were provided.")
        return [], []

    def find_closest_node(graph, target_pt):
        closest_node = None
        min_dist = float('inf')
        for node in graph.nodes:
            node_pt = rg.Point3d(node[0], node[1], node[2])
            dist = target_pt.DistanceTo(node_pt)
            if dist < min_dist:
                min_dist = dist
                closest_node = node
        return closest_node

    start_key = find_closest_node(G, start_pt)
    end_key = find_closest_node(G, end_pt)
    
    k_paths_curves = []
    k_paths_indices = [] 
    
    print("2. Calculating distinctly penalized paths...")
    for i in range(k):
        try:
            path = nx.shortest_path(G, source=start_key, target=end_key, weight='weight')
            
            path_curves = []
            raw_path_indices = []
            
            for j in range(len(path) - 1):
                node_a = path[j]
                node_b = path[j+1]
                
                path_curves.append(edge_geometries[(node_a, node_b)])
                raw_path_indices.append(edge_indices[(node_a, node_b)])
                
                current_weight = G[node_a][node_b]['weight']
                G[node_a][node_b]['weight'] = current_weight * penalty_factor
                
            joined_curves = rg.Curve.JoinCurves(path_curves)
            if joined_curves:
                k_paths_curves.append(joined_curves[0])
                
                clean_indices = []
                for idx in raw_path_indices:
                    if not clean_indices or clean_indices[-1] != idx:
                        clean_indices.append(idx)
                
                k_paths_indices.append(clean_indices)
                
        except nx.NetworkXNoPath:
            print(f"Stopped early at {i} routes: No more valid alternative paths exist.")
            break
        except Exception as e:
            print("An error occurred: " + str(e))
            break
            
    print(f"Success: Found {len(k_paths_curves)} distinct routes.")
    
    # NEW: Convert the nested Python list into a strict Grasshopper Data Tree
    gh_tree = Grasshopper.DataTree[System.Object]()
    for branch_index, indices_list in enumerate(k_paths_indices):
        path = GH_Path(branch_index)
        for index_val in indices_list:
            gh_tree.Add(index_val, path)
            
    return k_paths_curves, gh_tree

if Lines and StartPt and EndPt and K and Penalty:
    Routes, RouteIndices = get_distinct_paths_with_indices(Lines, StartPt, EndPt, K, Penalty)
# ---------- end n_shortest_routes ----------
item = ListItem(List=n_shortest_routes.Routes, Index=Slider(0, range=0..4), Wrap=invert(True))
panel_4 = Panel(n_shortest_routes.RouteIndices)

# ----
create_street_network = CreateStreetNetwork(
    StreetPolylines=import_osm_file_2.Polylines,
    CoordinateReference=import_osm_file_2.CoordinateReference,
    CleanStreets=True)  # -> StreetNetwork, CoordinateReference; disabled
tag = TextTag(Location=midpt, Text=index)  # disabled
import_buildings_2 = ImportBuildings(ProjectSetting=text, DataSource="osm", Terrain=True)  # -> _2DFootprints, _3DMeshes
lng = ListLength(List=n_shortest_routes.Routes)
index_2 = ItemIndex(List=n_shortest_routes.Routes, Item=n_shortest_routes.Routes)
import_streets = ImportStreets(ProjectSetting=text, DataSource="osm", Terrain=True)
swatch = ColourSwatch(SwatchColor=RGB(255, 0, 129))
gradient = Gradient(
    LowerLimit=0,
    UpperLimit=lng,
    Parameter=index_2,
    stops=[0: RGB(243, 57, 0), 0.1: RGB(236, 27, 60), 0.2: RGB(210, 0, 118), 0.3: RGB(103, 0, 120), 0.4: RGB(39, 72, 161), 0.5: RGB(1, 192, 229), 0.6: RGB(18, 178, 90), 0.7: RGB(79, 186, 8), 0.8: RGB(220, 237, 32), 0.9: RGB(247, 159, 20), 1: RGB(243, 57, 0)])
viewer = ParamViewer(n_shortest_routes.RouteIndices)
panel_5 = Panel(n_shortest_routes.out)

# ---- group: destination
pt_3 = Point(Point(5034.232252, 2606.704757, 0))  # disabled

# ---- group: origin
pt_4 = Point(Point(2486.27064, 2269.662603, 0))  # disabled

# ----
betwcent = BetweennessCentrality(StreetNetwork=create_street_network.StreetNetwork)  # -> StreetSegments, BetweennessCentrality; disabled
router = Router(
    Origin=pt,
    Destination=pt_2,
    TravelMode="(0): Walk",
    StreetNetwork=create_street_network.StreetNetwork,
    CoordinateReference=create_street_network.CoordinateReference,
    RoutingMetric="Comprehensive (Default)")  # -> Route, TravelTime, TravelDistance, CoordinateReference; disabled

# ----
# Visualize streets by type (based on OSM tags)
panel_6 = Panel("highway")
lookup_metadata = LookupMetadata(MetadataGeometry=import_streets, SearchKey=panel_6)
urbano_gradient = UrbanoGradient(
    Reverse=Button(),
    stops=[0: RGB(243, 57, 0), 0.1: RGB(236, 27, 60), 0.2: RGB(210, 0, 118), 0.3: RGB(103, 0, 120), 0.4: RGB(39, 72, 161), 0.5: RGB(1, 192, 229), 0.6: RGB(18, 178, 90), 0.7: RGB(79, 186, 8), 0.8: RGB(220, 237, 32), 0.9: RGB(247, 159, 20), 1: RGB(243, 57, 0)])
map_settings = MapSettings(Gradient=urbano_gradient, Legend=False, LegendTitle="OSM Street Tag", Label=False, LinewidthRange="0.5 to 5")
draw_map_2 = DrawMap(Geometries=import_streets, Values=lookup_metadata, MapSettings=map_settings)

# ---- group: Original Urbano router
router_2 = Router(RouterUrbanoModelOrStreetNetwork=model.UrbanoModel, Origin=pt_4, Destination=pt_3, TravelMode="car", TimeLimit=-1)  # -> Trip, Route, Time, Distance; disabled
crv = Curve(router_2.Route)  # disabled

# ---- group: New router gets more than one optimal route
number_slider = Slider(5, range=1..20)  # disabled
panel_7 = Panel("10.0")  # disabled
n_shortest_routes_2 = Python3Script(Lines=streetnet.StreetSegmentCurves, StartPt=pt_4, EndPt=pt_3, Penalty=panel_7, K=number_slider)  # -> out, Routes, RouteIndices; inputs Lines: list of Curve, StartPt: Point3d, EndPt: Point3d, Penalty: Double, K: Int32; disabled; same code as n_shortest_routes
number_slider_2 = Slider(1, range=0..4)  # disabled
item_2 = ListItem(List=n_shortest_routes_2.Routes, Index=number_slider_2, Wrap=invert(True))  # disabled
panel_8 = Panel(n_shortest_routes_2.RouteIndices)  # disabled

# ----
previewlw_2 = CustomPreviewLineweights(Geometry=n_shortest_routes.Routes, Shader=gradient, Thickness=Slider(3, range=0..10), Absolute=False)
explode = Explode(Curve=item, Recursive=True)  # -> Segments, Vertices

# ----
# Visualize building by type (based on OSM tags)
panel_9 = Panel("building")
lookup_metadata_2 = LookupMetadata(MetadataGeometry=import_buildings_2._3DMeshes, SearchKey=panel_9)
urbano_gradient_2 = UrbanoGradient(
    Reverse=Button(),
    stops=[0: RGB(243, 57, 0), 0.1: RGB(247, 159, 20), 0.2: RGB(220, 237, 32), 0.3: RGB(79, 186, 8), 0.4: RGB(18, 178, 90), 0.5: RGB(1, 192, 229), 0.6: RGB(39, 72, 161), 0.7: RGB(103, 0, 120), 0.8: RGB(210, 0, 118), 0.9: RGB(236, 27, 60), 1: RGB(243, 57, 0)])
map_settings_2 = MapSettings(Gradient=urbano_gradient_2, Legend=True, LegendTitle="OSM Building Tag", Label=False)
draw_map_3 = DrawMap(Geometries=import_buildings_2._3DMeshes, Values=lookup_metadata_2, MapSettings=map_settings_2)

midpt_2 = CurveMiddle(Curve=explode.Segments)

# ---- group: select one branch
number_slider_3 = Slider(0, range=0..4)  # disabled
branch = BranchByIndex(Tree=n_shortest_routes_2.RouteIndices, Branch=number_slider_3)  # disabled
item_3 = ListItem(List=streetnet.StreetSegmentCurves, Index=branch, Wrap=True)  # disabled
midpt_3 = CurveMiddle(Curve=item_3)  # disabled
tag_2 = TextTag(Location=midpt_3, Text=branch)  # disabled

# ----
viewer_2 = ParamViewer(n_shortest_routes_2.RouteIndices)  # disabled

# ---- group: select one branch
item_4 = ListItem(List=streetnet.StreetSegmentCurves, Index=n_shortest_routes_2.RouteIndices, Wrap=True)  # disabled
midpt_4 = CurveMiddle(Curve=item_4)  # disabled
tag_3 = TextTag(Location=midpt_4, Text=n_shortest_routes_2.RouteIndices)  # disabled

# ----
explode_2 = Explode(Curve=item_2, Recursive=True)  # -> Segments, Vertices; disabled
midpt_5 = CurveMiddle(Curve=explode_2.Segments)  # disabled
